# Dynamo graph RenameSheetsToMatchViewNames.dyn (Dynamo 1.3.1.1736)

# group: Get sheets containing exactly 1 view
boolean = BoolSelector(true)
# note: Lunchbox node package needs to be installed to use this node
lunchbox_sheet_collector = Custom[LunchBox Sheet Collector](Toggle=boolean)  # Collects sheets from the current document
# note: Ignore warning
views = Sheet.Views(lunchbox_sheet_collector.Element)
clean = List.Clean(list=views@L2)
count = List.Count(clean@L2)
number = DoubleInput(1)
eq = count == number
filterByBoolMask = List.FilterByBoolMask(list=lunchbox_sheet_collector.Element, mask=eq)
watch = Watch(filterByBoolMask.in)

# group: Get sheets containing only 1 floor plan
views_2 = Sheet.Views(filterByBoolMask.in)
type = Object.Type(views_2)
# note: Archi-lab node package must be installed to use View Type node
# Changing the view type will allow this script to rename sheets of the specified type instead of floor plans
view_type = ViewTypesUi("FloorPlan")
contains = String.Contains(str=type, searchFor=view_type)
flatten = Flatten(contains)
filterByBoolMask_2 = List.FilterByBoolMask(list=filterByBoolMask.in, mask=flatten@L2)
boolean_2 = BoolSelector(false)
clean_2 = List.Clean(list=filterByBoolMask_2.in, preserveIndices=boolean_2)
watch_2 = Watch(clean_2)
watch_3 = Watch(type)
watch_4 = Watch(flatten)

# group: Rename Sheets to Match View Names
flatten_2 = Flatten(clean_2)
string = StringInput("Sheet Name")
views_3 = Sheet.Views(flatten_2)
string_2 = StringInput("View Name")
getParameterValueByName = Element.GetParameterValueByName(parameterName=string_2)  # unwired: element
map = List.Map(list=views_3, f_x=getParameterValueByName)
setParameterByName = Element.SetParameterByName(element=flatten_2, parameterName=string, value=map)
name = Element.Name(setParameterByName)
watch_renamed_sheets = Watch(name)
watch_view_names = Watch(map)
